# Grasshopper definition SolarGAN_Hops_Template.gh (Grasshopper 1.0.7)
# plug-ins: Hops

brep = Brep(<brep referenced from the Rhino model>)
path = FilePath("C:\Users\phili\Documents\GitHub\SolarGAN\beta_vae_idgan\data\graycube\sg_graycube__23.PNG")
pt = Point(<point referenced from the Rhino model>)
path_2 = FilePath("C:\Users\phili\Documents\GitHub\hive\GrasshopperExamples\Templates\HIVE_Zurich.epw")
number_slider = Slider(1, range=0..100)
image_resource = ImageResource(path)
panel = Panel(path)
brep_cp = BrepClosestPoint(Point=pt, Brep=brep)  # -> Point, Normal, Distance
range = Range(Domain="[-1,1]", Steps=Slider(26, range=0..100))
hops = Hops(
    Path=path,
    CacheResultsInMemory=False,
    CacheSolveResults=False,
    RemoteDefinitionLocation="http://127.0.0.1:5000/att_processing",
    RemoteSolveVersion=(0, 1, 0),
    ShowInput_Enabled=False,
    ShowInput_Path=False,
    SynchronousSolve=True)  # -> C_mu, C_var
pt2num = PointsToNumbers(Points=brep_cp.Normal, Mask=4)
pt2num_2 = PointsToNumbers(Points=brep_cp.Point, Mask=4)
rev = ReverseList(List=range)
split = SplitList(List=range, Index=number_slider)  # -> ListA, ListB
split_2 = SplitList(List=rev, Index=number_slider)  # -> ListA, ListB
item = ListItem(List=pt2num_2, Index="2", Wrap=True)
item_2 = ListItem(List=pt2num, Index="1", Wrap=True)
item_3 = ListItem(List=pt2num, Index="0", Wrap=True)
flatten = FlattenTree(Tree=split.ListB, Path="{0}")
flatten_2 = FlattenTree(Tree=split_2.ListB, Path="{0}")
panel_2 = Panel(hops.C_mu)
flatten_3 = FlattenTree(Tree=item, Path="{0}")
flatten_4 = FlattenTree(Tree=item_3, Path="{0}")
flatten_5 = FlattenTree(Tree=item_2, Path="{0}")
merge = Merge(Data1=flatten, Data2=flatten_2)
panel_3 = Panel(flatten_3)
panel_4 = Panel(flatten_4)
panel_5 = Panel(flatten_5)
graph = QuickGraph(merge, SortOrder=0)
button = Button()
hops_2 = Hops(
    Run=Toggle(True),
    EnsembleSize=Slider(100, range=0..100),
    ImageFeatures=panel_2,
    Latitude=Slider(46.25, range=0..90),
    Longitude=Slider(6.13, range=0..180),
    Height=panel_3,
    SurfaceNormalX=panel_4,
    SurfaceNormalY=panel_5,
    SolarDeclination=merge,
    EPWFilePath=path_2,
    CacheResultsInMemory=False,
    CacheSolveResults=False,
    RemoteDefinitionLocation="http://127.0.0.1:5000/timeseries_gen",
    RemoteSolveVersion=(0, 1, 0),
    ShowInput_Enabled=False,
    ShowInput_Path=False,
    SynchronousSolve=True)  # -> TimeSeries, DNIWeeklyAverage, DNIWeeklyPeak, DHIWeeklyAverage, DHIWeeklyPeak, DNIWeeklyMaxAvg, DNIWeeklyMinAvg, DHIWeeklyMaxAvg, DHIWeeklyMinAvg
split_3 = SplitList(List=hops_2.TimeSeries, Index=Slider(168, range=0..1000))  # -> ListA, ListB
graph_2 = QuickGraph(hops_2.DNIWeeklyMaxAvg, SortOrder=0)
graph_3 = QuickGraph(hops_2.DHIWeeklyMaxAvg, SortOrder=0)
graph_4 = QuickGraph(hops_2.TimeSeries, SortOrder=0)
graph_5 = QuickGraph(hops_2.DNIWeeklyAverage, SortOrder=0)
graph_6 = QuickGraph(hops_2.DHIWeeklyAverage, SortOrder=0)
graph_7 = QuickGraph(hops_2.DNIWeeklyMinAvg, SortOrder=0)
graph_8 = QuickGraph(hops_2.DHIWeeklyMinAvg, SortOrder=0)
graph_9 = QuickGraph(hops_2.DNIWeeklyPeak, SortOrder=0)
graph_10 = QuickGraph(hops_2.DHIWeeklyPeak, SortOrder=0)
# 30: Glazing ratio
# 16: near far
# 12: up down
number_slider_2 = Slider(0, range=-5..5)
hops_3 = Hops(
    C_mu=panel_2,
    C_dim=Slider(17, range=0..100),
    Value=number_slider_2,
    CacheResultsInMemory=False,
    CacheSolveResults=False,
    RemoteDefinitionLocation="http://127.0.0.1:5000/wwr_traversal",
    RemoteSolveVersion=(0, 1, 0),
    ShowInput_Enabled=False,
    ShowInput_Path=False,
    SynchronousSolve=True)
image_resource_2 = ImageResource(hops_3)
