# Grasshopper definition unnamed.gh (Grasshopper 1.0.7)
# plug-ins: Hops

path = FilePath("C:\Users\phili\Documents\GitHub\SolarGAN\beta_vae_idgan\data\graycube\sg_graycube__11.PNG")
image_resource = ImageResource(path)
hops = Hops(
    Path=path,
    CacheResultsInMemory=False,
    CacheSolveResults=False,
    RemoteDefinitionLocation="http://127.0.0.1:5000/att_processing",
    RemoteSolveVersion=(0, 1, 0),
    ShowInput_Enabled=False,
    ShowInput_Path=False,
    SynchronousSolve=True)  # -> C_mu, C_var
panel = Panel(hops.C_mu)
panel_2 = Panel(hops.C_var)
number_slider = Slider(1, range=0..1)
hops_2 = Hops(
    Path=path,
    C_dim=Slider(4, range=0..100),
    Lim="1",
    Lim_d="-2.6",
    CacheResultsInMemory=False,
    CacheSolveResults=False,
    RemoteDefinitionLocation="http://127.0.0.1:5000/wwr_traversal",
    RemoteSolveVersion=(0, 1, 0),
    ShowInput_Enabled=False,
    ShowInput_Path=False,
    SynchronousSolve=True)
hops_3 = Hops(
    ImageFeatures=panel,
    Latitude=number_slider,
    Longitude=Slider(2, range=0..10),
    Height=number_slider,
    MonthlyIndex=number_slider,
    SolarDeclination=number_slider,
    WeatherStatistics=number_slider,
    CacheResultsInMemory=True,
    CacheSolveResults=True,
    RemoteDefinitionLocation="http://127.0.0.1:5000/timeseries_gen",
    RemoteSolveVersion=(0, 1, 0),
    ShowInput_Enabled=False,
    ShowInput_Path=False,
    SynchronousSolve=True)
item = ListItem(List=hops_2, Index=Slider(3, range=0..3), Wrap=True)
image_resource_2 = ImageResource(item)
panel_3 = Panel(item)
python = GhPythonScript()  # -> Out, A
